# Dynamo graph Dörrkort.dyn (Dynamo 2.3.0.5885)

# group: Get all doors
categories = Categories("OST_Doors")
all_elements_of_category = ElementsOfCategory(Category=categories)

# group: Import Excel File
file_path = Filename(".\dorrkort.xlsx")
file_from_path = FileObject(path=file_path)
string = StringInput("dorrkort")
boolean = BoolSelector(false)
importExcel = Data.ImportExcel(file=file_from_path, sheetName=string, readAsStrings=boolean, showExcel=boolean)

# group: The headers and the key column "DK"
firstItem = List.FirstItem(list=importExcel)

# group: Drop "DK"
code_block = CodeBlock { 1; }
dropItems = List.DropItems(list=firstItem, amount=code_block)

# group: String function ".title()"
python_script = Python(IN[0]=dropItems)
# ---------- python_script.python (15 lines) ----------
# Load the Python Standard and DesignScript Libraries
import sys
import clr
clr.AddReference('ProtoGeometry')
from Autodesk.DesignScript.Geometry import *

# The inputs to this node will be stored as a list in the IN variables.
dataEnteringNode = IN
a = IN[0]
b = []
# Place your code below this line
b = [i.title() for i in a]	

# Assign your output to the OUT variable.
OUT = b
# ----------------------------------------

# group: List management for the Spaces
count = List.Count(list=python_script)
ofRepeatedItem = List.OfRepeatedItem(item=all_elements_of_category, amount=count)
transpose = List.Transpose(lists=ofRepeatedItem)

# group: List management for parameter names
count_2 = List.Count(list=all_elements_of_category)
ofRepeatedItem_2 = List.OfRepeatedItem(item=python_script, amount=count_2)

python_script_2 = Python(IN[0]=importExcel)
# ---------- python_script_2.python (7 lines) ----------
data = IN[0]
dk = [i[0] for i in data]
params = [i[1:] for i in data]

di = dict(zip(dk,params))

OUT = di
# ----------------------------------------

# group: Extract the parameter "BeslagNummer"
code_block_2 = CodeBlock { "BeslagNummer"; }
getParameterValueByName = Element.GetParameterValueByName(element=all_elements_of_category, parameterName=code_block_2)

# group: Each door gets a list with all the values from the respective DK-row in Excel.
valueAtKey = DesignScript.Builtin.Dictionary.ValueAtKey(dictionary=python_script_2, key=getParameterValueByName)

setParameterByName = Element.SetParameterByName(element=transpose, parameterName=ofRepeatedItem_2, value=valueAtKey)
